# Grasshopper definition weav.gh (Grasshopper 1.0.7)
# plug-ins: Weaverbird

number_slider = Slider(4, range=0..10)
subdivision = GetNumber(Slider(1, range=0..10), AtLeast=1, AtMost=3, Maximum=1.797693135e+308, Minimum=-1.797693135e+308)
mbox = MeshBox(
    Base={Plane=PlaneXY(0, 0, 0), X=Domain(-10, 10), Y=Domain(-10, 10), Z=Domain(-10, 10)},
    XCount=number_slider,
    YCount=number_slider,
    ZCount=number_slider)
wbcatmullclark = WeaverbirdsCatmullClarkSubdivision(MeshCurves=mbox, Level=subdivision, SmoothNakedEdges=1)
medges = MeshEdges(Mesh=wbcatmullclark)  # -> NakedEdges, InteriorEdges, NonManifoldEdges

# ---- group: RH_OUT:edges
crv = Curve(medges.InteriorEdges)
